# Grasshopper definition KinergyMainInterface.gh (Grasshopper 1.0.7)
# plug-ins: Human UI

# ---- group: Playground for testing
c_script = CSharpScript()  # -> out, A
# ---------- c_script: C# ----------
    string str1 = System.AppDomain.CurrentDomain.BaseDirectory;
    A = str1;
# ---------- end c_script ----------
panel = Panel(c_script.A)

# ----
python = GhPythonScript()  # -> out, a
# ---------- python: Python ----------
__author__ = "lianghe"
__version__ = "2020.04.19"

import rhinoscriptsyntax as rs

import os

pre_path = os.path.abspath('.')[:os.path.abspath('.').rfind('\\')]
a=pre_path+"\Plug-ins\Grasshopper\Components\Resources\images\ReciprocalMovingIcon.png"
# ---------- end python ----------
python_2 = GhPythonScript()  # -> out, a
# ---------- python_2: Python ----------
__author__ = "lianghe"
__version__ = "2020.04.19"

import rhinoscriptsyntax as rs

import os

pre_path = os.path.abspath('.')[:os.path.abspath('.').rfind('\\')]
a=pre_path+"\Plug-ins\Grasshopper\Components\Resources\images\ContinuousSpinningIcon.png"
# ---------- end python_2 ----------
python_3 = GhPythonScript()  # -> out, a
# ---------- python_3: Python ----------
__author__ = "lianghe"
__version__ = "2020.04.19"

import rhinoscriptsyntax as rs

import os

pre_path = os.path.abspath('.')[:os.path.abspath('.').rfind('\\')]
a=pre_path+"\Plug-ins\Grasshopper\Components\Resources\images\ContinuousLinearMovingIcon.png"
# ---------- end python_3 ----------
python_4 = GhPythonScript()  # -> out, a
# ---------- python_4: Python ----------
__author__ = "lianghe"
__version__ = "2020.04.19"

import rhinoscriptsyntax as rs

import os

pre_path = os.path.abspath('.')[:os.path.abspath('.').rfind('\\')]
a=pre_path+"\Plug-ins\Grasshopper\Components\Resources\images\InstantExtensionIcon.png"
# ---------- end python_4 ----------
python_5 = GhPythonScript()  # -> out, a
# ---------- python_5: Python ----------
__author__ = "lianghe"
__version__ = "2020.04.19"

import rhinoscriptsyntax as rs

import os

pre_path = os.path.abspath('.')[:os.path.abspath('.').rfind('\\')]
a=pre_path+"\Plug-ins\Grasshopper\Components\Resources\images\InstantSpinningIcon.png"
# ---------- end python_5 ----------
width = Slider(330, range=0..1000)
height = Slider(56, range=0..1000)
number_slider = Slider(0, range=0..100)

# ---- group: Intermittent Motion Group
python_6 = GhPythonScript()  # -> out, a
# ---------- python_6: Python ----------
__author__ = "lianghe"
__version__ = "2020.04.19"

import rhinoscriptsyntax as rs

import os

pre_path = os.path.abspath('.')[:os.path.abspath('.').rfind('\\')]
a=pre_path+"\Plug-ins\Grasshopper\Components\Resources\images\IntermittentHoppingIcon.png"
# ---------- end python_6 ----------
button = CreateButton(ImagePath=python_6.a, ButtonStyle=0)
adjustpos = AdjustElementPositioning(
    ElementsToAdjust=button,
    Margin="10,10,0,10",
    AbsolutePositioning=False,
    Width=width,
    Height=height,
    HorizontalAlignment=number_slider)
expander = CreateExpander(UIElements=button, Header="Intermittent Motion", Open=True)

# ----
values = ValueListener(Elements=button, SomeProperty=True)  # -> Values, Indices

# ---- group: Instant Motion Group
python_7 = GhPythonScript()  # -> out, a
# ---------- python_7: Python ----------
__author__ = "lianghe"
__version__ = "2020.04.19"

import rhinoscriptsyntax as rs

import os

pre_path = os.path.abspath('.')[:os.path.abspath('.').rfind('\\')]
a=pre_path+"\Plug-ins\Grasshopper\Components\Resources\images\InstantThrowingIcon.png"
# ---------- end python_7 ----------
button_2 = CreateButton(ImagePath=python_5.a, ButtonStyle=0)
button_3 = CreateButton(ImagePath=python_4.a, ButtonStyle=0)
button_4 = CreateButton(ImagePath=python_7.a, ButtonStyle=0)
adjustpos_2 = AdjustElementPositioning(
    ElementsToAdjust=button_4,
    Margin="10,10,0,10",
    AbsolutePositioning=False,
    Width=width,
    Height=height,
    HorizontalAlignment=number_slider)
merge = Merge(Data1=button_3, Data2=button_2, Data3=button_4)
expander_2 = CreateExpander(UIElements=merge, Header="Instant Motion", Open=True)
values_2 = ValueListener(Elements=button_4, SomeProperty=True)  # -> Values, Indices
values_3 = ValueListener(Elements=button_3, SomeProperty=True)  # -> Values, Indices
values_4 = ValueListener(Elements=button_2, SomeProperty=True)  # -> Values, Indices

# ---- group: Continuous Motion Group
button_5 = CreateButton(ImagePath=python_3.a, ButtonStyle=0)
button_6 = CreateButton(ImagePath=python_2.a, ButtonStyle=0)
button_7 = CreateButton(ImagePath=python.a, ButtonStyle=0)
adjustpos_3 = AdjustElementPositioning(
    ElementsToAdjust=button_7,
    Margin="10,10,0,10",
    AbsolutePositioning=False,
    Width=width,
    Height=height,
    HorizontalAlignment=number_slider)
adjustpos_4 = AdjustElementPositioning(ElementsToAdjust=[button_2, button_6], Margin="0,10,0,10", AbsolutePositioning=False, Width=width, Height=height)
merge_2 = Merge(Data1=button_5, Data2=button_6, Data3=button_7)
expander_3 = CreateExpander(UIElements=merge_2, Header="Continuous Motion", Open=True)
values_5 = ValueListener(Elements=button_5, SomeProperty=True)  # -> Values, Indices
values_6 = ValueListener(Elements=button_6, SomeProperty=True)  # -> Values, Indices
values_7 = ValueListener(Elements=button_7, SomeProperty=True)  # -> Values, Indices

# ---- group: Instant Motion Group (continued)
adjustpos_5 = AdjustElementPositioning(
    ElementsToAdjust=[button_3, button_5],
    Margin="10,10,0,10",
    AbsolutePositioning=False,
    Width=width,
    Height=height,
    HorizontalAlignment=number_slider)

# ---- group: MAIN WINDOW
merge_3 = Merge(Data1=expander_2, Data2=expander, Data3=expander_3)
launchwin = LaunchWindow(
    Show=Toggle(True),
    Name="Kinergy",
    Width=Slider(380, range=0..1000),
    Height=Slider(710, range=0..1000),
    ChildStatus=0,
    EnableHorizScroll=False)
addelems = AddElements(Window=launchwin, Elements=flatten(merge_3), DoVLChecking=True)  # -> AddedElements, ElementNames

# ----
selectchildwindow = GhPythonScript(
    c0=values_3.Values,
    c1=values_4.Values,
    c2=values_2.Values,
    c3=values.Values,
    c4=values_5.Values,
    c5=values_6.Values,
    c6=values_7.Values)  # -> c0_2, c1_2, c2_2, c3_2, c4_2, c5_2, c6_2; inputs c0: Boolean, c1: Boolean, c2: Boolean, c3: Boolean, c4: Boolean, c5: Boolean, c6: Boolean
# ---------- selectchildwindow: Python ----------
__author__ = "liang he"
__version__ = "2020.04.20"

import rhinoscriptsyntax as rs
def compareValue(a,b):
    if(a==b):
        return False;
    return True;

#Make persistent value to keep track of last value
if "lastValue" not in globals():
    lastValue=[c0,c1,c2,c3,c4,c5,c6];

#Check that current value is different from last value
newValue=[c0,c1,c2,c3,c4,c5,c6];
for i,val in enumerate(newValue):
    if val==True:
        lastValue=[False,False,False,False,False,False,False];
        lastValue[i]=True;
        break;
        
c0_2=lastValue[0];
c1_2=lastValue[1];
c2_2=lastValue[2];
c3_2=lastValue[3];
c4_2=lastValue[4];
c5_2=lastValue[5];
c6_2=lastValue[6];
# ---------- end selectchildwindow ----------

# ---- group: TOADD: CHILDWINDOW
ie_height = Slider(170, range=0..1000)
ie_width = Slider(700, range=0..1000)
launchwin_2 = LaunchWindow(Show=selectchildwindow.c6_2, Name="Reciprocal Moving", Width=370, Height=400, ChildStatus=0, EnableHorizScroll=False)
launchwin_3 = LaunchWindow(
    Show=selectchildwindow.c0_2,
    Name="Instant Extension Motion",
    Width=ie_width,
    Height=ie_height,
    ChildStatus=0,
    EnableHorizScroll=False)
launchwin_4 = LaunchWindow(
    Show=selectchildwindow.c1_2,
    Name="Instant Spinning Motion",
    Width=370,
    Height=400,
    ChildStatus=0,
    EnableHorizScroll=False)
launchwin_5 = LaunchWindow(
    Show=selectchildwindow.c5_2,
    Name="Continuous Spinning Motion",
    Width=370,
    Height=400,
    ChildStatus=0,
    EnableHorizScroll=False)
launchwin_6 = LaunchWindow(Show=selectchildwindow.c2_2, Name="Instant Throwing", Width=370, Height=400, ChildStatus=0, EnableHorizScroll=False)
launchwin_7 = LaunchWindow(
    Show=selectchildwindow.c4_2,
    Name="Continuous Linear Moving Motion",
    Width=370,
    Height=400,
    ChildStatus=0,
    EnableHorizScroll=False)
launchwin_8 = LaunchWindow(
    Show=selectchildwindow.c3_2,
    Name="Intermittent Hopping Motion",
    Width=370,
    Height=400,
    ChildStatus=0,
    EnableHorizScroll=False)
childwin = MakeChildWindow(ParentWindow=launchwin, ChildWindow=launchwin_3)
childwin_2 = MakeChildWindow(ParentWindow=launchwin, ChildWindow=launchwin_4)
childwin_3 = MakeChildWindow(ParentWindow=launchwin, ChildWindow=launchwin_6)
childwin_4 = MakeChildWindow(ParentWindow=launchwin, ChildWindow=launchwin_8)
childwin_5 = MakeChildWindow(ParentWindow=launchwin, ChildWindow=launchwin_7)
childwin_6 = MakeChildWindow(ParentWindow=launchwin, ChildWindow=launchwin_5)
childwin_7 = MakeChildWindow(ParentWindow=launchwin, ChildWindow=launchwin_2)

# ---- group: Instant Extension Window Style
displacement = Slider(3, range=0..5)
energy = Slider(3, range=1..5)
height_2 = Slider(30, range=0..500)
border_corner_radius = Slider(0, range=0..10)
slider = CreateSlider(Slider=displacement, ShowBounds=False, ShowTicks=False, ShowTooltip=False, ShowValLabel=True, showLabel=True)
adjustpos_6 = AdjustElementPositioning(ElementsToAdjust=slider, Margin="5,-20,0,0", AbsolutePositioning=False, Height=height_2)
thumbnail_width = Slider(100, range=0..1000)
title_size = Slider(12, range=0..20)
title_size_2 = Slider(16, range=0..20)
border_thickness = Slider(1, range=0..10)
height_3 = Slider(30, range=0..500)
width_2 = Slider(340, range=0..500)
panel_2 = Panel("This unit consists of three parts: a helical spring, a rod, and a locking mechanism. It can be compressed and locked. After the lock is released, the spring extends immediately.")
slider_2 = CreateSlider(Slider=energy, ShowBounds=False, ShowTicks=False, ShowTooltip=False, ShowValLabel=True, showLabel=True)
adjustpos_7 = AdjustElementPositioning(ElementsToAdjust=slider_2, Margin="30,25,0,0", AbsolutePositioning=False, Height=height_3)
merge_4 = Merge(Data1=slider, Data2=slider_2)
python_8 = GhPythonScript()  # -> out, a
# ---------- python_8: Python ----------
__author__ = "lianghe"
__version__ = "2020.04.19"

import rhinoscriptsyntax as rs

import os

pre_path = os.path.abspath('.')[:os.path.abspath('.').rfind('\\')]
a=pre_path+"\Plug-ins\Grasshopper\Components\Resources\images\IE.png"
# ---------- end python_8 ----------
height_4 = Slider(30, range=0..500)
width_3 = Slider(123, range=0..500)
height_5 = Slider(30, range=0..500)
width_4 = Slider(200, range=0..500)
colour = ColourPicker(PickedColour=RGB(43, 170, 214))
image = CreateImage(ImageSource=python_8.a, ImageWidth=thumbnail_width, ImageHeight=thumbnail_width)
checkbox = CreateCheckbox(Label="Lock", StartingValue=Toggle(False))
label = CreateLabel(LabelText="Instant Extension Unit", LabelSize=title_size_2, Justification=0)
tb = CreateTextBlock(Text=panel_2, TextSize=title_size, Justification=0)
button_8 = CreateButton(ButtonName="Set Motion Direction", ButtonStyle=0)
button_9 = CreateButton(ButtonName="Preview Motion", ButtonStyle=0)
border = CreateBorder(UIElement=merge_4, BorderThickness=border_thickness, BorderColor=colour, CornerRadius=border_corner_radius)
adjustpos_8 = AdjustElementPositioning(ElementsToAdjust=label, Margin="110,-120,0,10", AbsolutePositioning=False)
adjustpos_9 = AdjustElementPositioning(ElementsToAdjust=tb, Margin="-240,-90,10,10", AbsolutePositioning=False, Width=width_4)
adjustpos_10 = AdjustElementPositioning(ElementsToAdjust=image, Margin="10,10,10,10", AbsolutePositioning=False)
adjustpos_11 = AdjustElementPositioning(ElementsToAdjust=button_8, Margin="100,-190,0,10", AbsolutePositioning=False, Width=width_3, Height=height_4)
adjustpos_12 = AdjustElementPositioning(ElementsToAdjust=checkbox, Margin="480,-190,0,10", AbsolutePositioning=False)
adjustpos_13 = AdjustElementPositioning(ElementsToAdjust=button_9, Margin="550,-190,0,10", AbsolutePositioning=False, Height=height_5)
adjustpos_14 = AdjustElementPositioning(ElementsToAdjust=border, Margin="320,-70,0,10", AbsolutePositioning=False, Width=width_2)
title_size_3 = Slider(9, range=0..20)
width_5 = Slider(70, range=0..500)
height_6 = Slider(22, range=0..500)
colour_2 = ColourPicker(PickedColour=RGB(255, 255, 255))
colour_3 = ColourPicker(PickedColour=RGB(43, 170, 255))
label_2 = CreateLabel(LabelText="Motion Design", LabelSize=title_size_3, Justification=0)
merge_5 = Merge(Data1=image, Data2=label, Data3=tb, Data4=button_8, Data5=checkbox, Data6=button_9, Data7=border, Data8=label_2)
adjustpos_15 = AdjustElementPositioning(ElementsToAdjust=label_2, Margin="50,-145,0,0", AbsolutePositioning=False, Width=width_5, Height=height_6)
addelems_2 = AddElements(Window=launchwin_3, Elements=flatten(merge_5), DoVLChecking=True)  # -> AddedElements, ElementNames
adjustelem = AdjustElementAppearance(ElementsToAdjust=label_2, Foreground=colour_2, Background=colour_3)

# ----
values_8 = ValueListener(Elements=button_8, SomeProperty=True)  # -> Values, Indices
